# Grasshopper definition test.gh (Grasshopper 1.0.8)
# plug-ins: eleFront, IPMSpatialAnalysis

txt = Text(Slider(1, range=1..8))
path = FilePath("G:\My Drive\PHD\Data\IPM\Lattices\MAT")
join = TextJoin(Text=[path, txt], Join="\")
files = ListFiles(Folder=join, SearchMask="*.csv", recursive=True)
split = TextSplit(Text=files, Separators="_")
mesh = Mesh([<mesh referenced from the Rhino model> x2846])
item = ListItem(List=split, Index="1", Wrap=True)  # -> flatten(Item)
sort = SortList(Keys=item, ValuesA=files)  # -> Keys, ValuesA
multiplication = Multiplication(A=sort.Keys, B=Slider(0.05, range=0..0.1))
voxelisedata = VoxeliseData(
    Input=sort.ValuesA,
    XColumnName="GalvoXActualCartesian",
    YColumnName="GalvoYActualCartesian",
    DataColumnName="Photodiode1Normalised",
    LayerHeights=multiplication,
    PointReadInterval=1,
    VoxelSize=Slider(0.2, range=0.2..1),
    Method=0,
    ExtractionRadius=1,
    Reset=False)
voxelisepores = VoxelisePores(PoreMeshes=mesh, VoxelData=voxelisedata, KClosestPoints=10)
spatialcorrelation = SpatialCorrelation(VoxelData=voxelisedata, VoxelRadius=1)
dom = ConstructDomain(DomainStart=Slider(1.69, range=0..8.45), DomainEnd=Slider(8.45, range=0..8.45))
move = Move(Geometry=voxelisepores, Motion=Vector(0, 0, 10))  # -> Geometry, Transform
filtervoxels = FilterVoxels(VoxelData=voxelisepores, ScalarRange=dom, RemoveZeros=False, Normalise=False)
explodevoxels = ExplodeVoxels(VoxelData=voxelisepores)  # -> VoxelCentres, VoxelValues
nickname = CorrelationCoefficients(VoxelData1=spatialcorrelation, VoxelData2=voxelisepores)  # -> PearsonCoefficient, PearsonP, SpearmanRankCoefficient, SpearmanP
bnd = Bounds(Numbers=explodevoxels.VoxelValues)
voxelpreview = VoxelPreview(VoxelData=filtervoxels, ScalarRange=bnd, PointWeight=5)
